% Simulink data dictionary microgrid_system.sldd

Batt = Simulink.Bus()
  P: double
  Q: double

Batt_Mode = Simulink.Bus()
  CurrOrVoltSource: double
  GenOrSynchMode: double

ESS_Mode = Simulink.Bus()
  ControlType: double
  Bus_Batt_Mode: Bus: Batt_Mode

Grid = Simulink.Bus()
  P: double
  Q: double

PowerBus = Simulink.Bus()
  Bus_Grid: Bus: Grid
  Bus_Batt: Bus: Batt

genMax = 5000000
Ts = 5.0e-5
Tc = 5.0e-5
Ts_Control = 5.0e-5
Ts_PLC = 0.001